# Grasshopper definition composite_joint_demo_code.ghx (Grasshopper 1.0.8)

py3 = Python3Script(use_composite=Toggle(True))  # -> out, a
# ---------- py3: Python ----------
from compas.geometry import Line, Point

from compas_timber.elements import Beam
from compas_timber.model import TimberModel
from compas_timber.connections import (
    LButtJoint,
    LMiterJoint,
    TButtJoint,
    JointTopology,
    JointCandidate,
)
from timber_design.workflow import (
    DirectRule,
    CategoryRule,
    TopologyRule,
    CompositeJointRule,
    JointRuleSolver,
)

edge_beams = [
    Beam.from_centerline(
        Line(Point(0, 0, 0), Point(1000, 1000, 0)), 100, 100, category="edge"
    ),
    Beam.from_centerline(
        Line(Point(0, 0, 0), Point(-1000, 0, 0)), 100, 100, category="edge"
    ),
    Beam.from_centerline(
        Line(Point(1000, 1000, 0), Point(0, 1000, 0)), 100, 100, category="edge"
    ),
    Beam.from_centerline(
        Line(Point(0, 1000, 0), Point(-1000, 0, 0)), 100, 100, category="edge"
    ),
]

butt_beams = [
    Beam.from_centerline(
        Line(Point(0, 0, 0), Point(0, 1000, 0)), 100, 100, category="butt"
    ),
    Beam.from_centerline(
        Line(Point(-500, 0, 0), Point(-500, 500, 0)), 100, 100, category="butt"
    ),
    Beam.from_centerline(
        Line(Point(0, 0, 0), Point(1000, -1000, 0)), 100, 100, category="edge"
    ),
]

model = TimberModel()
for element in edge_beams + butt_beams:
    model.add_element(element)

model.connect_adjacent_beams()

pairwise_rules = [
    TopologyRule(JointTopology.TOPO_T, TButtJoint, mill_depth=10),
    CategoryRule(LButtJoint, "edge", "edge"),
    CategoryRule(LButtJoint, "butt", "edge", mill_depth=10, modify_cross=False),
]


composite_rules = [
    CompositeJointRule(
        [
            CategoryRule(LButtJoint, "edge", "edge", mill_depth=10),
            CategoryRule(LButtJoint, "butt", "edge", mill_depth=10, modify_cross=False),
        ],
        max_element_count=3,
    ),
    CompositeJointRule(
        [TopologyRule(JointTopology.TOPO_L, LMiterJoint)], min_element_count=4
    ),
]

if use_composite:
    jrs = JointRuleSolver(pairwise_rules + composite_rules)
else:
    jrs = JointRuleSolver(pairwise_rules)


jrs.apply_rules_to_model(model)

model.process_joinery()

a = model
# ---------- end py3 ----------
py3_2 = Python3Script(x=py3.a)  # -> out, a
# ---------- py3_2: Python ----------
a = [e for e in x.elements()]
# ---------- end py3_2 ----------
draw = Draw_compas_geometry(cg=py3_2.a)  # -> rg
# ---------- draw: Python ----------
"""
Draws COMPAS geometry in Grasshopper.
"""
from compas_model.elements import Element

from ghpythonlib.componentbase import executingcomponent as component

from compas.scene import SceneObject


class CompasToRhinoGeometry(component):
    def RunScript(self, cg):
        if not cg:
            return None
        if isinstance(cg, Element):
            cg=cg.modelgeometry
        return SceneObject(item=cg).draw()
# ---------- end draw ----------
